# Grasshopper definition 17_Agents_Output_Jupyter_Python.gh (Grasshopper 1.0.8)
# plug-ins: Weaverbird

file_path = FilePath(["C:\Users\aditya.soman\source\repos\Loci_Python\Case_Simulation\Financial_Center\17_Agents\Zoning_Options_f_000.csv", "C:\Users\aditya.soman\source\repos\Loci_Python\Case_Simulation\Financial_Center\17_Agents\Zoning_Options_f_001.csv", "C:\Users\aditya.soman\source\repos\Loci_Python\Case_Simulation\Financial_Center\17_Agents\Zoning_Options_f_002.csv", "C:\Users\aditya.soman\source\repos\Loci_Python\Case_Simulation\Financial_Center\17_Agents\Zoning_Options_f_003.csv", "C:\Users\aditya.soman\source\repos\Loci_Python\Case_Simulation\Financial_Center\17_Agents\Zoning_Options_f_004.csv", "C:\Users\aditya.soman\source\repos\Loci_Python\Case_Simulation\Financial_Center\17_Agents\Zoning_Options_f_005.csv"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])
load_lattice = GhPythonScript(path=file_path, frame=Slider(83, range=0..99))  # -> out, minbound, unit, shape, lattice; inputs path: list, frame: Int32
# ---------- load_lattice: Python ----------
import Rhino.Geometry as rg
import csv
import ast

def read_csv(path):
    records = []
    minbound,shape,unit = [],[],[]
    with open(path) as csvfile:
        spamreader = csv.reader(csvfile, delimiter=',', quotechar='|')
        for i, row in enumerate(spamreader):
            if 0 < i < 4:
                vals = [ast.literal_eval(item) for item in row]
                minbound.append(vals[0])
                shape.append(vals[1])
                unit.append(vals[2])
            if i > 5:
                records.append([ast.literal_eval(item) for item in row])
    return (records,minbound,shape,unit)
    
# retrieve results
lattice, minbound, shape, unit = read_csv(path[frame])
# ---------- end load_lattice ----------
number_slider = Slider(3, range=0..10)
number_slider_2 = Slider(0, range=0..100)
number_slider_3 = Slider(100, range=0..100)
construct_domain = ConstructDomain(DomainStart=expr("x/2", number_slider), DomainEnd=expr("-x/2", number_slider))
construct_domain_2 = ConstructDomain(DomainStart=number_slider_2, DomainEnd=number_slider_3)
range = Range(Domain=construct_domain_2, Steps=expr("x-1", Slider(18, range=0..100)))
number_slider_4 = Slider(0.6, range=0..1)
gradient = Gradient(
    LowerLimit=number_slider_2,
    UpperLimit=number_slider_3,
    Parameter=range,
    stops=[0: RGB(234, 38, 0), 0.25: RGB(234, 126, 0), 0.5: RGB(254, 244, 84), 0.75: RGB(173, 203, 249), 1: RGB(75, 107, 169)])
lattice_to_points = GhPythonScript(
    minbound=load_lattice.minbound,
    unit=load_lattice.unit,
    shape=load_lattice.shape,
    lattice=load_lattice.lattice,
    low_bound=Slider(0, range=0..100),
    high_bound=Slider(1, range=0..1000))  # -> out, points, values; inputs minbound: list, unit: list, shape: list, lattice: list
# ---------- lattice_to_points: Python ----------
import Rhino.Geometry as rg

points = []
values = []
for row in lattice:
    if  low_bound <= row[3] <= high_bound:
        point = rg.Point3d(row[0]*unit[0] + minbound[0], row[1]*unit[1] + minbound[1], row[2]*unit[2] + minbound[2])
        points.append(point)
        values.append(row[3])
# ---------- end lattice_to_points ----------
lattice_to_points_2 = GhPythonScript(
    minbound=load_lattice.minbound,
    unit=load_lattice.unit,
    shape=load_lattice.shape,
    lattice=load_lattice.lattice,
    low_bound=Slider(9, range=0..100),
    high_bound=Slider(11, range=0..1000))  # -> out, points, values; inputs minbound: list, unit: list, shape: list, lattice: list; same code as lattice_to_points
lattice_to_points_3 = GhPythonScript(
    minbound=load_lattice.minbound,
    unit=load_lattice.unit,
    shape=load_lattice.shape,
    lattice=load_lattice.lattice,
    low_bound=Slider(29, range=0..1000),
    high_bound=Slider(31, range=0..1000))  # -> out, points, values; inputs minbound: list, unit: list, shape: list, lattice: list; same code as lattice_to_points
lattice_to_points_4 = GhPythonScript(
    minbound=load_lattice.minbound,
    unit=load_lattice.unit,
    shape=load_lattice.shape,
    lattice=load_lattice.lattice,
    low_bound=Slider(19, range=0..100),
    high_bound=Slider(21, range=0..1000))  # -> out, points, values; inputs minbound: list, unit: list, shape: list, lattice: list; same code as lattice_to_points
lattice_to_points_5 = GhPythonScript(
    minbound=load_lattice.minbound,
    unit=load_lattice.unit,
    shape=load_lattice.shape,
    lattice=load_lattice.lattice,
    low_bound=Slider(39, range=0..1000),
    high_bound=Slider(41, range=0..1000))  # -> out, points, values; inputs minbound: list, unit: list, shape: list, lattice: list; same code as lattice_to_points
lattice_to_points_6 = GhPythonScript(
    minbound=load_lattice.minbound,
    unit=load_lattice.unit,
    shape=load_lattice.shape,
    lattice=load_lattice.lattice,
    low_bound=Slider(49, range=0..1000),
    high_bound=Slider(51, range=0..1000))  # -> out, points, values; inputs minbound: list, unit: list, shape: list, lattice: list; same code as lattice_to_points
lattice_to_points_7 = GhPythonScript(
    minbound=load_lattice.minbound,
    unit=load_lattice.unit,
    shape=load_lattice.shape,
    lattice=load_lattice.lattice,
    low_bound=Slider(59, range=0..1000),
    high_bound=Slider(61, range=0..1000))  # -> out, points, values; inputs minbound: list, unit: list, shape: list, lattice: list; same code as lattice_to_points
lattice_to_points_8 = GhPythonScript(
    minbound=load_lattice.minbound,
    unit=load_lattice.unit,
    shape=load_lattice.shape,
    lattice=load_lattice.lattice,
    low_bound=Slider(79, range=0..1000),
    high_bound=Slider(81, range=0..1000))  # -> out, points, values; inputs minbound: list, unit: list, shape: list, lattice: list; same code as lattice_to_points
lattice_to_points_9 = GhPythonScript(
    minbound=load_lattice.minbound,
    unit=load_lattice.unit,
    shape=load_lattice.shape,
    lattice=load_lattice.lattice,
    low_bound=Slider(89, range=0..1000),
    high_bound=Slider(91, range=0..1000))  # -> out, points, values; inputs minbound: list, unit: list, shape: list, lattice: list; same code as lattice_to_points
lattice_to_points_10 = GhPythonScript(
    minbound=load_lattice.minbound,
    unit=load_lattice.unit,
    shape=load_lattice.shape,
    lattice=load_lattice.lattice,
    low_bound=Slider(69, range=0..1000),
    high_bound=Slider(71, range=0..1000))  # -> out, points, values; inputs minbound: list, unit: list, shape: list, lattice: list; same code as lattice_to_points
lattice_to_points_11 = GhPythonScript(
    minbound=load_lattice.minbound,
    unit=load_lattice.unit,
    shape=load_lattice.shape,
    lattice=load_lattice.lattice,
    low_bound=Slider(99, range=0..1000),
    high_bound=Slider(101, range=0..1000))  # -> out, points, values; inputs minbound: list, unit: list, shape: list, lattice: list; same code as lattice_to_points
number_slider_5 = Slider(0.1, range=0..1)
lattice_to_points_12 = GhPythonScript(
    minbound=load_lattice.minbound,
    unit=load_lattice.unit,
    shape=load_lattice.shape,
    lattice=load_lattice.lattice,
    low_bound=Slider(109, range=0..1000),
    high_bound=Slider(111, range=0..1000))  # -> out, points, values; inputs minbound: list, unit: list, shape: list, lattice: list; same code as lattice_to_points
domain_box = DomainBox(Base=lattice_to_points_4.points, X=construct_domain, Y=construct_domain, Z=construct_domain)
domain_box_2 = DomainBox(Base=lattice_to_points_2.points, X=construct_domain, Y=construct_domain, Z=construct_domain)
domain_box_3 = DomainBox(Base=lattice_to_points_3.points, X=construct_domain, Y=construct_domain, Z=construct_domain)
lattice_to_points_13 = GhPythonScript(
    minbound=load_lattice.minbound,
    unit=load_lattice.unit,
    shape=load_lattice.shape,
    lattice=load_lattice.lattice,
    low_bound=Slider(129, range=0..1000),
    high_bound=Slider(131, range=0..1000))  # -> out, points, values; inputs minbound: list, unit: list, shape: list, lattice: list; same code as lattice_to_points
domain_box_4 = DomainBox(Base=lattice_to_points_8.points, X=construct_domain, Y=construct_domain, Z=construct_domain)
domain_box_5 = DomainBox(Base=lattice_to_points_9.points, X=construct_domain, Y=construct_domain, Z=construct_domain)
lattice_to_points_14 = GhPythonScript(
    minbound=load_lattice.minbound,
    unit=load_lattice.unit,
    shape=load_lattice.shape,
    lattice=load_lattice.lattice,
    low_bound=Slider(119, range=0..1000),
    high_bound=Slider(121, range=0..1000))  # -> out, points, values; inputs minbound: list, unit: list, shape: list, lattice: list; same code as lattice_to_points
domain_box_6 = DomainBox(Base=lattice_to_points_5.points, X=construct_domain, Y=construct_domain, Z=construct_domain)
domain_box_7 = DomainBox(Base=lattice_to_points_6.points, X=construct_domain, Y=construct_domain, Z=construct_domain)
lattice_to_points_15 = GhPythonScript(
    minbound=load_lattice.minbound,
    unit=load_lattice.unit,
    shape=load_lattice.shape,
    lattice=load_lattice.lattice,
    low_bound=Slider(139, range=0..1000),
    high_bound=Slider(141, range=0..1000))  # -> out, points, values; inputs minbound: list, unit: list, shape: list, lattice: list; same code as lattice_to_points
domain_box_8 = DomainBox(Base=lattice_to_points_7.points, X=construct_domain, Y=construct_domain, Z=construct_domain)
domain_box_9 = DomainBox(Base=lattice_to_points_11.points, X=construct_domain, Y=construct_domain, Z=construct_domain)
domain_box_10 = DomainBox(Base=lattice_to_points.points, X=construct_domain, Y=construct_domain, Z=construct_domain)
list_item = ListItem(List=gradient, Index="0", Wrap=True)
domain_box_11 = DomainBox(Base=lattice_to_points_10.points, X=construct_domain, Y=construct_domain, Z=construct_domain)
lattice_to_points_16 = GhPythonScript(
    minbound=load_lattice.minbound,
    unit=load_lattice.unit,
    shape=load_lattice.shape,
    lattice=load_lattice.lattice,
    low_bound=Slider(149, range=0..1000),
    high_bound=Slider(151, range=0..1000))  # -> out, points, values; inputs minbound: list, unit: list, shape: list, lattice: list; same code as lattice_to_points
lattice_to_points_17 = GhPythonScript(
    minbound=load_lattice.minbound,
    unit=load_lattice.unit,
    shape=load_lattice.shape,
    lattice=load_lattice.lattice,
    low_bound=Slider(159, range=0..1000),
    high_bound=Slider(161, range=0..1000))  # -> out, points, values; inputs minbound: list, unit: list, shape: list, lattice: list; same code as lattice_to_points
domain_box_12 = DomainBox(Base=lattice_to_points_12.points, X=construct_domain, Y=construct_domain, Z=construct_domain)
lattice_to_points_18 = GhPythonScript(
    minbound=load_lattice.minbound,
    unit=load_lattice.unit,
    shape=load_lattice.shape,
    lattice=load_lattice.lattice,
    low_bound=Slider(169, range=0..1000),
    high_bound=Slider(171, range=0..1000))  # -> out, points, values; inputs minbound: list, unit: list, shape: list, lattice: list; same code as lattice_to_points
domain_box_13 = DomainBox(Base=lattice_to_points_13.points, X=construct_domain, Y=construct_domain, Z=construct_domain)
list_item_2 = ListItem(List=gradient, Index="2", Wrap=True)
list_item_3 = ListItem(List=gradient, Index="1", Wrap=True)
domain_box_14 = DomainBox(Base=lattice_to_points_14.points, X=construct_domain, Y=construct_domain, Z=construct_domain)
list_item_4 = ListItem(List=gradient, Index="3", Wrap=True)
list_item_5 = ListItem(List=gradient, Index="4", Wrap=True)
list_item_6 = ListItem(List=gradient, Index="5", Wrap=True)
list_item_7 = ListItem(List=gradient, Index="7", Wrap=True)
domain_box_15 = DomainBox(Base=lattice_to_points_15.points, X=construct_domain, Y=construct_domain, Z=construct_domain)
list_item_8 = ListItem(List=gradient, Index="8", Wrap=True)
list_item_9 = ListItem(List=gradient, Index="6", Wrap=True)
domain_box_16 = DomainBox(Base=lattice_to_points_16.points, X=construct_domain, Y=construct_domain, Z=construct_domain)
domain_box_17 = DomainBox(Base=lattice_to_points_17.points, X=construct_domain, Y=construct_domain, Z=construct_domain)
list_item_10 = ListItem(List=gradient, Index="9", Wrap=True)
create_material = CreateMaterial(Diffuse=list_item, Specular=RGB(255, 255, 255), Emission=RGB(0, 0, 0), Transparency=number_slider_5, Shine=0)
create_material_2 = CreateMaterial(
    Diffuse=ColourSwatch(SwatchColor=RGB(212, 232, 111)),
    Specular=RGB(255, 255, 255),
    Emission=RGB(0, 0, 0),
    Transparency=Slider(0, range=0..1),
    Shine=0)
domain_box_18 = DomainBox(Base=lattice_to_points_18.points, X=construct_domain, Y=construct_domain, Z=construct_domain)
create_material_3 = CreateMaterial(Diffuse=list_item_3, Specular=RGB(255, 255, 255), Emission=RGB(0, 0, 0), Transparency=number_slider_5, Shine=0)
create_material_4 = CreateMaterial(Diffuse=list_item_2, Specular=RGB(255, 255, 255), Emission=RGB(0, 0, 0), Transparency=number_slider_5, Shine=0)
list_item_11 = ListItem(List=gradient, Index="10", Wrap=True)
create_material_5 = CreateMaterial(Diffuse=list_item_5, Specular=RGB(255, 255, 255), Emission=RGB(0, 0, 0), Transparency=number_slider_5, Shine=0)
list_item_12 = ListItem(List=gradient, Index="12", Wrap=True)
create_material_6 = CreateMaterial(Diffuse=list_item_4, Specular=RGB(255, 255, 255), Emission=RGB(0, 0, 0), Transparency=number_slider_5, Shine=0)
create_material_7 = CreateMaterial(Diffuse=list_item_6, Specular=RGB(255, 255, 255), Emission=RGB(0, 0, 0), Transparency=number_slider_5, Shine=0)
create_material_8 = CreateMaterial(Diffuse=list_item_7, Specular=RGB(255, 255, 255), Emission=RGB(0, 0, 0), Transparency=number_slider_5, Shine=0)
list_item_13 = ListItem(List=gradient, Index="11", Wrap=True)
create_material_9 = CreateMaterial(Diffuse=list_item_8, Specular=RGB(255, 255, 255), Emission=RGB(0, 0, 0), Transparency=number_slider_5, Shine=0)
list_item_14 = ListItem(List=gradient, Index="13", Wrap=True)
create_material_10 = CreateMaterial(Diffuse=list_item_9, Specular=RGB(255, 255, 255), Emission=RGB(0, 0, 0), Transparency=number_slider_5, Shine=0)
create_material_11 = CreateMaterial(Diffuse=list_item_10, Specular=RGB(255, 255, 255), Emission=RGB(0, 0, 0), Transparency=number_slider_5, Shine=0)
list_item_15 = ListItem(List=gradient, Index="14", Wrap=True)
list_item_16 = ListItem(List=gradient, Index="15", Wrap=True)
custom_preview = CustomPreview(Geometry=domain_box_10, Material=create_material_2)
custom_preview_2 = CustomPreview(Geometry=domain_box_2, Material=create_material)
list_item_17 = ListItem(List=gradient, Index="16", Wrap=True)
custom_preview_3 = CustomPreview(Geometry=domain_box_3, Material=create_material_4)
create_material_12 = CreateMaterial(Diffuse=list_item_11, Specular=RGB(255, 255, 255), Emission=RGB(0, 0, 0), Transparency=number_slider_5, Shine=0)
custom_preview_4 = CustomPreview(Geometry=domain_box, Material=create_material_3)
create_material_13 = CreateMaterial(Diffuse=list_item_12, Specular=RGB(255, 255, 255), Emission=RGB(0, 0, 0), Transparency=number_slider_5, Shine=0)
custom_preview_5 = CustomPreview(Geometry=domain_box_6, Material=create_material_6)
custom_preview_6 = CustomPreview(Geometry=domain_box_7, Material=create_material_5)
create_material_14 = CreateMaterial(Diffuse=list_item_13, Specular=RGB(255, 255, 255), Emission=RGB(0, 0, 0), Transparency=number_slider_5, Shine=0)
custom_preview_7 = CustomPreview(Geometry=domain_box_8, Material=create_material_7)
custom_preview_8 = CustomPreview(Geometry=domain_box_4, Material=create_material_8)
create_material_15 = CreateMaterial(Diffuse=list_item_14, Specular=RGB(255, 255, 255), Emission=RGB(0, 0, 0), Transparency=number_slider_5, Shine=0)
custom_preview_9 = CustomPreview(Geometry=domain_box_5, Material=create_material_9)
custom_preview_10 = CustomPreview(Geometry=domain_box_11, Material=create_material_10)
create_material_16 = CreateMaterial(Diffuse=list_item_15, Specular=RGB(255, 255, 255), Emission=RGB(0, 0, 0), Transparency=number_slider_5, Shine=0)
create_material_17 = CreateMaterial(Diffuse=list_item_16, Specular=RGB(255, 255, 255), Emission=RGB(0, 0, 0), Transparency=number_slider_5, Shine=0)
custom_preview_11 = CustomPreview(Geometry=domain_box_9, Material=create_material_11)
create_material_18 = CreateMaterial(Diffuse=list_item_17, Specular=RGB(255, 255, 255), Emission=RGB(0, 0, 0), Transparency=number_slider_5, Shine=0)
custom_preview_12 = CustomPreview(Geometry=domain_box_12, Material=create_material_12)
custom_preview_13 = CustomPreview(Geometry=domain_box_13, Material=create_material_13)
custom_preview_14 = CustomPreview(Geometry=domain_box_14, Material=create_material_14)
custom_preview_15 = CustomPreview(Geometry=domain_box_15, Material=create_material_15)
custom_preview_16 = CustomPreview(Geometry=domain_box_16, Material=create_material_16)
custom_preview_17 = CustomPreview(Geometry=domain_box_17, Material=create_material_17)
custom_preview_18 = CustomPreview(Geometry=domain_box_18, Material=create_material_18)
deconstruct_brep = DeconstructBrep(Brep=domain_box_2)  # -> Faces, Edges, Vertices; disabled
number_slider_6 = Slider(4, range=0..8)  # disabled
list_item_18 = ListItem(List=deconstruct_brep.Faces, Index=number_slider_6, Wrap=True)  # disabled
brep_join = BrepJoin(Breps=flatten(list_item_18))  # -> Breps, Closed; disabled
mesh = Mesh(brep_join.Breps)  # disabled
weaverbird_s_naked_boundary = WeaverbirdsNakedBoundary(MeshClosedPolylines=mesh)  # disabled
surface = Surface(weaverbird_s_naked_boundary)  # disabled
custom_preview_19 = CustomPreview(Geometry=surface, Material=create_material)  # disabled
