# Grasshopper definition Center_excel.gh (Grasshopper 1.0.8)
# plug-ins: ExcelPlus

curve = Curve(<curve referenced from the Rhino model>)
divide_curve = DivideCurve(Curve=curve, Count=Slider(100, range=0..10000), Kinks=False)  # -> Points, Tangents, Parameters
point = Point([<point referenced from the Rhino model> x8])
deconstruct = Deconstruct(Point=divide_curve.Points)  # -> XComponent, YComponent, ZComponent
panel = Panel(deconstruct.XComponent)
panel_2 = Panel(deconstruct.ZComponent)
panel_3 = Panel(deconstruct.YComponent)
merge = Merge(Data1=graft(deconstruct.XComponent), Data2=graft(deconstruct.YComponent), Data3=graft(deconstruct.ZComponent))
cell_content = CellContent(Value=merge)  # -> Cell, Location, Value, Format, Formula
panel_4 = Panel(merge)
construct_worksheet = ConstructWorksheet(Worksheet="abcd")
generate_cells = GenerateCells(ByColumn=True)
construct_workbook = ConstructWorkbook(Workbook=merge, Worksheet=construct_worksheet)
boolean_toggle = BooleanToggle(False)
write_workbook = WriteWorkbook(Workbook=construct_workbook, Activate=boolean_toggle)  # -> Workbook, Stream
file_path = FilePath("C:\Users\aditya.soman\source\repos\Loci_Python\Obj_Data\")
open_workbook = OpenWorkbook()
save_workbook = SaveWorkbook(Workbook=write_workbook.Workbook, FolderPath=file_path, FileName="test", Extensions=0, Activate=boolean_toggle)  # -> Workbook, FilePath
