# Grasshopper definition Low_Poly_Bunny_GH.gh (Grasshopper 1.0.8)
# plug-ins: Hops

number_slider = Slider(0.025, range=0..0.1)
number_slider_2 = Slider(0.0025, range=0..0.01)
curve = Curve(<curve referenced from the Rhino model>)
hops = Hops(
    Curve=curve,
    T=Slider(0.8, range=0..1),
    CacheResultsInMemory=True,
    CacheSolveResults=True,
    RemoteDefinitionLocation="http://127.0.0.1:5000/pointat",
    RemoteSolveVersion=(0, 1, 0),
    ShowInput_Enabled=False,
    ShowInput_Path=False,
    SynchronousSolve=True)
center_box = CenterBox(Base=hops, X=number_slider_2, Y=number_slider_2, Z=number_slider_2)
