# Grasshopper definition Jupyter_Python.gh (Grasshopper 1.0.8)

file_path = FilePath(["C:\Users\aditya.soman\source\repos\Loci_Python\Simulation_Outputs\abm_f_000.csv", "C:\Users\aditya.soman\source\repos\Loci_Python\Simulation_Outputs\abm_f_001.csv", "C:\Users\aditya.soman\source\repos\Loci_Python\Simulation_Outputs\abm_f_002.csv", "C:\Users\aditya.soman\source\repos\Loci_Python\Simulation_Outputs\abm_f_003.csv", "C:\Users\aditya.soman\source\repos\Loci_Python\Simulation_Outputs\abm_f_004.csv", "C:\Users\aditya.soman\source\repos\Loci_Python\Simulation_Outputs\abm_f_005.csv"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])
load_lattice = GhPythonScript(path=file_path, frame=Slider(600, range=0..600))  # -> out, minbound, unit, shape, lattice; inputs path: list, frame: Int32
# ---------- load_lattice: Python ----------
import Rhino.Geometry as rg
import csv
import ast

def read_csv(path):
    records = []
    minbound,shape,unit = [],[],[]
    with open(path) as csvfile:
        spamreader = csv.reader(csvfile, delimiter=',', quotechar='|')
        for i, row in enumerate(spamreader):
            if 0 < i < 4:
                vals = [ast.literal_eval(item) for item in row]
                minbound.append(vals[0])
                shape.append(vals[1])
                unit.append(vals[2])
            if i > 5:
                records.append([ast.literal_eval(item) for item in row])
    return (records,minbound,shape,unit)
    
# retrieve results
lattice, minbound, shape, unit = read_csv(path[frame])
# ---------- end load_lattice ----------
number_slider = Slider(3, range=0..10)
construct_domain = ConstructDomain(DomainStart=expr("x/2", number_slider), DomainEnd=expr("-x/2", number_slider))
number_slider_2 = Slider(0.6, range=0..1)
lattice_to_points = GhPythonScript(
    minbound=load_lattice.minbound,
    unit=load_lattice.unit,
    shape=load_lattice.shape,
    lattice=load_lattice.lattice,
    low_bound=Slider(8, range=0..100),
    high_bound=Slider(9, range=0..1000))  # -> out, points, values; inputs minbound: list, unit: list, shape: list, lattice: list
# ---------- lattice_to_points: Python ----------
import Rhino.Geometry as rg

points = []
values = []
for row in lattice:
    if  low_bound <= row[3] <= high_bound:
        point = rg.Point3d(row[0]*unit[0] + minbound[0], row[1]*unit[1] + minbound[1], row[2]*unit[2] + minbound[2])
        points.append(point)
        values.append(row[3])
# ---------- end lattice_to_points ----------
lattice_to_points_2 = GhPythonScript(
    minbound=load_lattice.minbound,
    unit=load_lattice.unit,
    shape=load_lattice.shape,
    lattice=load_lattice.lattice,
    low_bound=Slider(18, range=0..1000),
    high_bound=Slider(21, range=0..1000))  # -> out, points, values; inputs minbound: list, unit: list, shape: list, lattice: list; same code as lattice_to_points
lattice_to_points_3 = GhPythonScript(
    minbound=load_lattice.minbound,
    unit=load_lattice.unit,
    shape=load_lattice.shape,
    lattice=load_lattice.lattice,
    low_bound=Slider(11, range=0..100),
    high_bound=Slider(13, range=0..1000))  # -> out, points, values; inputs minbound: list, unit: list, shape: list, lattice: list; same code as lattice_to_points
lattice_to_points_4 = GhPythonScript(
    minbound=load_lattice.minbound,
    unit=load_lattice.unit,
    shape=load_lattice.shape,
    lattice=load_lattice.lattice,
    low_bound=Slider(23, range=0..1000),
    high_bound=Slider(26, range=0..1000))  # -> out, points, values; inputs minbound: list, unit: list, shape: list, lattice: list; same code as lattice_to_points
number_slider_3 = Slider(0.1, range=0..1)
domain_box = DomainBox(Base=lattice_to_points.points, X=construct_domain, Y=construct_domain, Z=construct_domain)
domain_box_2 = DomainBox(Base=lattice_to_points_3.points, X=construct_domain, Y=construct_domain, Z=construct_domain)
domain_box_3 = DomainBox(Base=lattice_to_points_2.points, X=construct_domain, Y=construct_domain, Z=construct_domain)
domain_box_4 = DomainBox(Base=lattice_to_points_4.points, X=construct_domain, Y=construct_domain, Z=construct_domain)
create_material = CreateMaterial(
    Diffuse=ColourSwatch(SwatchColor=RGB(72, 128, 255)),
    Specular=RGB(255, 255, 255),
    Emission=RGB(0, 0, 0),
    Transparency=number_slider_3,
    Shine=0)
create_material_2 = CreateMaterial(
    Diffuse=ColourSwatch(SwatchColor=RGB(164, 230, 139)),
    Specular=RGB(255, 255, 255),
    Emission=RGB(0, 0, 0),
    Transparency=number_slider_3,
    Shine=0)
create_material_3 = CreateMaterial(
    Diffuse=ColourSwatch(SwatchColor=RGB(245, 249, 139)),
    Specular=RGB(255, 255, 255),
    Emission=RGB(0, 0, 0),
    Transparency=number_slider_3,
    Shine=0)
create_material_4 = CreateMaterial(
    Diffuse=ColourSwatch(SwatchColor=RGB(239, 111, 113)),
    Specular=RGB(255, 255, 255),
    Emission=RGB(0, 0, 0),
    Transparency=number_slider_3,
    Shine=0)
custom_preview = CustomPreview(Geometry=domain_box, Material=create_material)
custom_preview_2 = CustomPreview(Geometry=domain_box_2, Material=create_material_2)
custom_preview_3 = CustomPreview(Geometry=domain_box_3, Material=create_material_3)
custom_preview_4 = CustomPreview(Geometry=domain_box_4, Material=create_material_4)
